test file "DelayModel"

suite "Delay Tests"

  case "Delays Testing CasADi_delay" [baseline]
    model MPC3DoF, stop time 40
    parameter set "Parameter Set 1":
      controller_type = ControllerType.CasADi_delay  % model workspace
      x0 = [100 100 0 0 1.5707963267949 0]  % model workspace
      xf = [0 0 0 0 1.5707963267949 0]  % model workspace
      enable_turbulence = false  % model workspace
      optimization_time = 0.3  % model workspace
    assessment "Small Error": At any point of time, whenever true is true then, with a delay of at most 9999, SmallErrorStop must be true
    assessment "Ground Hit": At any point of time, GroundHitStop == false(whenever true is true then, with a delay of at most 9999, SmallErrorStop must be true) must be true
      SmallErrorStop: signal MPC3DoF/Small Error Stop Condiiton, port 1
      GroundHitStop: signal MPC3DoF/Ground Hit, port 1
    iteration script:
      %% Iterate over various delay times
      %%increment most likely by 0.1 seconds.
      delay = 0.1:0.2:3;


      % Create each iteration
      for d = 1 : numel(delay)
          % Set up a new iteration object
          testItr = sltestiteration();

          delay_table = delay(d);
              % Set iteration settings
          setVariable(testItr,'Name','optimization_time','Source','model workspace', 'Value', delay_table);

              % Register the iteration to run in this test case
          addIteration(sltest_testCase, testItr, sprintf("Delay_%.3f", delay(d)));

      end

  case "Delays Testing CasADi_freetf_delay" [baseline]
    model MPC3DoF, stop time 40
    parameter set "Parameter Set 1":
      controller_type = ControllerType.CasADi_freetf_delay  % model workspace
      x0 = [100 100 0 0 1.5707963267949 0]  % model workspace
      xf = [0 0 0 0 1.5707963267949 0]  % model workspace
      enable_turbulence = false  % model workspace
      optimization_time = 0.3  % model workspace
    assessment "Small Error": At any point of time, whenever true is true then, with a delay of at most 9999, SmallErrorStop must be true
    assessment "Ground Hit": At any point of time, GroundHitStop == false must be true
      SmallErrorStop: signal MPC3DoF/Small Error Stop Condiiton, port 1
      GroundHitStop: signal MPC3DoF/Ground Hit, port 1
    iteration script: same code as in iteration script of case "Delays Testing CasADi_delay"