test file "MismodelingModel"

suite "Tests"

  case "Mismodeling Model" [baseline]
    description: Testing rates (max_throttle_rate, max_gimbal_rate) as well as com, inertia, and mass errors affect controller performance.
    model MPC3DoF
    parameter set "Parameter Set 1":
      com_error = 0  % model workspace
      inertia_error = 0  % model workspace
      mass_error = 0  % model workspace
      max_gimbal_rate = 1  % model workspace
      max_throttle_rate = 0.05  % model workspace
    iteration script:
      %% Iterative Parameters

      com_error = 0:0.05:0.1;
      inertia_error = -0.10:0.1:0.1;
      mass_error = -0.1:0.1:0.1; %add in gain on 3dof
      max_gimbal_rate = 0:0.05:0.1;

      %% Iterate over controller types
      controller_types = [ControllerType.CasADi, ...
                          ControllerType.CasADi_freetf, ...
                          ControllerType.CasADi_delay, ...
                          ControllerType.CasADi_freetf_delay];

      % only running off of one controller rn


      controller_types = controller_types(3);


      %%
      for c = 1 : numel(controller_types)
          for e = 1:numel(com_error)
              for i = 1:numel(inertia_error)
                  for m = 1:numel(mass_error)
                      for g = 1:numel(max_gimbal_rate)
                        %  for t = 1:numel(max_throttle_rate)

                              testItr = sltestiteration();
                              setVariable(testItr,'Name','controller_type','Source','model workspace', 'Value', controller_types(c));
                              setVariable(testItr,'Name','com_error','Source','model workspace', 'Value', com_error(c));
                              setVariable(testItr,'Name','inertia_error','Source','model workspace', 'Value', inertia_error(i));
                              setVariable(testItr,'Name','mass_error','Source','model workspace', 'Value', mass_error(m));
                              setVariable(testItr,'Name','max_gimbal_rate','Source','model workspace', 'Value', max_gimbal_rate(g));
                             % setVariable(testItr,'Name','max_throttle_rate','Source','model workspace', 'Value', max_throttle_rate(t));

              % Register the iteration to run in this test case
                              addIteration(sltest_testCase, testItr, sprintf("Comm_Error_%.3f %s", "Inertia_error_%.3f", "Mass_error_%.3f", "Max_gimbal_%.3f", com_error(e), inertia_error(i), mass_error(m), max_gimbal_rate(g), controller_types(c)));
                         % end
                      end
                  end
              end
          end
      end